# Dynamo graph Install Pip For Dynamo Revit.dyn (Dynamo 2.16.1.2727)

check_update_and_install = BoolSelector(false)  # graph input
install_pip = Python(IN[0]=check_update_and_install)  # CPython3; graph output
# ---------- install_pip.python (59 lines) ----------
#LinkedIn : https://www.linkedin.com/in/chuncahk/
#https://github.com/chuncahk/villsDynamo/tree/main/DynamoPip

# Load the Python Standard and DesignScript Libraries
import sys
import clr
import os
import subprocess
clr.AddReference('ProtoGeometry')
from Autodesk.DesignScript.Geometry import *
import urllib.request

# The inputs to this node will be stored as a list in the IN variables.
dataEnteringNode = IN
update = IN[0]
# Place your code below this line
local_appdata = os.getenv('LOCALAPPDATA')
python_version = sys.version.title().split(' ')[0]

if int(python_version.split('.')[0]) < 3:
    OUT = 'Abort, Python version must be 3 and onward'
else:
    def find_dynamo_python_dir():
        for f in os.listdir(local_appdata):
            if python_version in f:
                if os.path.isdir(local_appdata + '\\' + f):
                    dynamo_python_dir = local_appdata + '\\' + f + '\\'
                    return dynamo_python_dir
                    
    def update_path_file(dy_python_dir):
        for file in os.listdir(dy_python_dir):
            print(file)
            if '._pth' in file:
                python_path_file = dynamo_python_dir + file
                with open(python_path_file,'r') as path_file:
                    content = path_file.read()
                    if '#import' in content:
                        with open(python_path_file,'w') as path_file:
                            path_file.write(content.replace('#import','import'))
                        break
    
    dynamo_python_dir = find_dynamo_python_dir()
    update_path_file(dynamo_python_dir)
    
    pip_exe = dynamo_python_dir+'Scripts'+'\\' + 'pip.exe'
    pip3_exe = dynamo_python_dir+'Scripts'+'\\' + 'pip3.exe'
    
    pip_installed = False
    if os.path.exists(pip_exe) and os.path.exists(pip3_exe):
        pip_installed = True

    if pip_installed == False or update == True:
        with open(dynamo_python_dir+'get-pip.py', 'wb') as pip_install:
            pip_install.write(urllib.request.urlopen('https://bootstrap.pypa.io/get-pip.py').read())
        proc = subprocess.run(dynamo_python_dir+'python.exe' + ' ' + dynamo_python_dir+'get-pip.py',shell = False,stdout=subprocess.PIPE)
        
        OUT = proc.stdout.decode('utf-8')
    else:
        OUT = 'Pip already installed, installation cancelled'
# ----------------------------------------
