# Dynamo graph Install Python Module.dyn (Dynamo 2.16.1.2727)

module_name = StringInput("")  # graph input
install_module = Python(IN[0]=module_name)  # IronPython2; graph output
# ---------- install_module.python (45 lines) ----------
#LinkedIn : https://www.linkedin.com/in/chuncahk/
#https://github.com/chuncahk/villsDynamo/tree/main/DynamoPip
  
# Load the Python Standard and DesignScript Libraries
import sys
import clr
import os
import subprocess
clr.AddReference('ProtoGeometry')
from Autodesk.DesignScript.Geometry import *

# The inputs to this node will be stored as a list in the IN variables.
dataEnteringNode = IN
module_name = IN[0]
# Place your code below this line
local_appdata = os.getenv('LOCALAPPDATA')
python_version = sys.version.title().split(' ')[0]

def find_dynamo_python_dir():
    for f in os.listdir(local_appdata):
        if python_version in f:
            if os.path.isdir(local_appdata + '\\' + f):
                dynamo_python_dir = local_appdata + '\\' + f + '\\'
                return dynamo_python_dir

def install_module(dy_python_dir,module_name):
    if dy_python_dir is None:
        return 'Dynamo Python directory not found'
    else:
        script_path = dy_python_dir+'Scripts\\'
        proc = subprocess.run(script_path + 'pip install ' + module_name, shell = False,stdout=subprocess.PIPE)
        proc_result = proc.stdout.decode('utf-8')
        return proc_result

if int(python_version.split('.')[0]) < 3:
    OUT = 'Abort, python version need to be 3 and onwards'
elif module_name == '':
    OUT = 'No module name provided'
elif not module_name == '':
    dynamo_python_dir = find_dynamo_python_dir()
    proc_result = install_module(dynamo_python_dir,module_name)
    if proc_result == '':
        OUT = 'Python Module not found'
    else:
        OUT = proc_result
# ----------------------------------------
